# Dynamo graph Final Dynamo.dyn "A Chappel de lomas adaption (REAL)" (Dynamo 3.4.2.7731)
# packages: Structural Analysis for Dynamo 3.4.2

# group: Inputs
square_size = IntegerSlider(16, range=0..100 step 1)
height = IntegerSlider(24, range=0..100 step 1)
z_offset_center_hight = DoubleSlider(4.5, range=0..20 step 0.2)
arch_angle = DoubleSlider(1, range=0..5 step 0.1)
grid_size = CodeBlock { 0.5; }

# group: Creating Scaled-up Overlying Hypar Surface
length = CodeBlock(a=square_size) { a*(1.5)/2; a*(-1.5)/2; }
height_2 = CodeBlock(a=height, z=z_offset_center_hight) { (a/2)*(Math.Pow(1.5,2))+z; (-a/2)*(Math.Pow(1.5,2))+z; }
byCoordinates = Point.ByCoordinates(x=length.out0, y=length.out1, z=height_2.out0)
byCoordinates_2 = Point.ByCoordinates(x=length.out1, y=length.out1, z=height_2.out1)
byStartPointEndPoint = Line.ByStartPointEndPoint(startPoint=byCoordinates, endPoint=byCoordinates_2)
byCoordinates_3 = Point.ByCoordinates(x=length.out0, y=length.out0, z=height_2.out1)
byCoordinates_4 = Point.ByCoordinates(x=length.out1, y=length.out0, z=height_2.out0)
byStartPointEndPoint_2 = Line.ByStartPointEndPoint(startPoint=byCoordinates_3, endPoint=byCoordinates_4)
list_create = List.Create(item0=byStartPointEndPoint, item1=byStartPointEndPoint_2)
byStartPointEndPoint_3 = Line.ByStartPointEndPoint(startPoint=byCoordinates_3, endPoint=byCoordinates)
byStartPointEndPoint_4 = Line.ByStartPointEndPoint(startPoint=byCoordinates_4, endPoint=byCoordinates_2)
list_create_2 = List.Create(item0=byStartPointEndPoint_3, item1=byStartPointEndPoint_4)
creating_scaled_hypar_surface = PolySurface.ByLoftGuides(crossSections=list_create, guideCurves=list_create_2)

# group: Creating Hypar Surface
length_2 = CodeBlock(a=square_size) { a/2; -a/2; }
height_3 = CodeBlock(a=height, z=z_offset_center_hight) { (a/2 + z); (-a/2+ z); }
byCoordinates_5 = Point.ByCoordinates(x=length_2.out0, y=length_2.out1, z=height_3.out0)
byCoordinates_6 = Point.ByCoordinates(x=length_2.out1, y=length_2.out1, z=height_3.out1)
byStartPointEndPoint_5 = Line.ByStartPointEndPoint(startPoint=byCoordinates_5, endPoint=byCoordinates_6)
byCoordinates_7 = Point.ByCoordinates(x=length_2.out0, y=length_2.out0, z=height_3.out1)
byCoordinates_8 = Point.ByCoordinates(x=length_2.out1, y=length_2.out0, z=height_3.out0)
byStartPointEndPoint_6 = Line.ByStartPointEndPoint(startPoint=byCoordinates_7, endPoint=byCoordinates_8)
list_create_3 = List.Create(item0=byStartPointEndPoint_5, item1=byStartPointEndPoint_6)
byStartPointEndPoint_7 = Line.ByStartPointEndPoint(startPoint=byCoordinates_7, endPoint=byCoordinates_5)
byStartPointEndPoint_8 = Line.ByStartPointEndPoint(startPoint=byCoordinates_8, endPoint=byCoordinates_6)
list_create_4 = List.Create(item0=byStartPointEndPoint_7, item1=byStartPointEndPoint_8)
creating_hypar_surface = PolySurface.ByLoftGuides(crossSections=list_create_3, guideCurves=list_create_4)

# group: Generating Arches
ZAxis = Vector.ZAxis()
creating_xy_plane = Plane.ByOriginNormal(normal=ZAxis)
creating_support_arches = Geometry.Intersect(geometry=creating_hypar_surface, other=creating_xy_plane)
startPoint = Curve.StartPoint(curve=creating_support_arches)
X = Point.X(point=startPoint)
code_block = CodeBlock(x=X, s=arch_angle) { x/s; }
endPoint = Curve.EndPoint(curve=creating_support_arches)
reverse = List.Reverse(list=endPoint)
Y = Point.Y(point=reverse)
code_block_2 = CodeBlock(x=Y, s=arch_angle) { x/s; }
byCoordinates_9 = Point.ByCoordinates(x=code_block, y=code_block_2)
list_create_5 = List.Create(item0=startPoint, item1=byCoordinates_9, item2=reverse)
transpose = List.Transpose(lists=list_create_5)
code_block_3 = CodeBlock { 2; }
creating_flat_arches = NurbsCurve.ByControlPoints(points=transpose, degree=code_block_3)
code_block_4 = CodeBlock { 10; }
extruding_flat_arches = Curve.Extrude(curve=creating_flat_arches, distance=code_block_4)
creating_3d_arches = Geometry.Intersect(geometry=creating_scaled_hypar_surface, other=extruding_flat_arches)

# group: Creating Hypar Grid
flatten = List.Flatten(list=creating_3d_arches)
deconstruct = List.Deconstruct(list=flatten)
deconstruct_2 = List.Deconstruct(list=creating_support_arches)
list_of_bounding_curves = List.Create(item0=deconstruct.first, item1=deconstruct_2.first, item2=deconstruct.rest, item3=deconstruct_2.rest)
flatten_2 = List.Flatten(list=list_of_bounding_curves)
creating_hypar_grid = Python(IN[0]=creating_scaled_hypar_surface, IN[1]=flatten_2, IN[2]=grid_size, IN[3]=grid_size)  # CPython3; unwired: IN[4]
# ---------- creating_hypar_grid.python (281 lines) ----------
import sys
import clr, math
clr.AddReference('ProtoGeometry')
from Autodesk.DesignScript.Geometry import Point, Line, PolyCurve, Geometry

# Inputs
srf = IN[0]
boundary = IN[1]
divX = IN[2]
divY = IN[3]
zBuffer = IN[4] if len(IN) > 4 and IN[4] else 10.0

def ensure_polycurve(b):
    if isinstance(b, list):
        return PolyCurve.ByJoinedCurves(b)
    return b

def flatten_curve_xy(curve, samples=50):

    pts = []
    try:
        for i in range(samples):
            t = float(i) / (samples - 1)
            p = curve.PointAtParameter(t)
            pts.append(Point.ByCoordinates(p.X, p.Y, 0))
    except:
        p1 = curve.StartPoint
        p2 = curve.EndPoint
        pts = [
            Point.ByCoordinates(p1.X, p1.Y, 0),
            Point.ByCoordinates(p2.X, p2.Y, 0)
        ]

    return PolyCurve.ByPoints(pts)


def point_in_poly(x, y, poly_pts):
    inside = False
    n = len(poly_pts)
    if n == 0: 
        return False
    j = n - 1
    for i in range(n):
        xi, yi = poly_pts[i]
        xj, yj = poly_pts[j]
        intersect = ((yi > y) != (yj > y)) and (x < (xj - xi) * (y - yi) / (yj - yi + 1e-12) + xi)
        if intersect:
            inside = not inside
        j = i
    return inside

def nearest_index(val, arr):
    #Return index of nearest value in arr to val (arr is list of numbers)
    if not arr:
        return None
    return min(range(len(arr)), key=lambda i: abs(arr[i] - val))

# --- Main ---
if srf is None or boundary is None or divX is None or divY is None:
    OUT = ("Error: missing input(s)", None, None)
else:
    poly = ensure_polycurve(boundary)
    try:
        boundary_curves = list(poly.Curves())
    except:
        boundary_curves = [poly]

    # flatten all curves to XY
    flat_curves = [flatten_curve_xy(c) for c in boundary_curves]

    bb = poly.BoundingBox
    minX, minY, minZ = bb.MinPoint.X, bb.MinPoint.Y, bb.MinPoint.Z
    maxX, maxY, maxZ = bb.MaxPoint.X, bb.MaxPoint.Y, bb.MaxPoint.Z
    
    gridX = float(divX)   # spacing in X direction
    gridY = float(divY)   # spacing in Y direction
    
    if gridX <= 0:
        gridX = 1.0
    if gridY <= 0:
        gridY = 1.0

    # Grid spacing
    gx = float(gridX)
    gy = float(gridY)
    
    # Max extents from origin
    halfRangeX = max(abs(minX), abs(maxX))
    halfRangeY = max(abs(minY), abs(maxY))
    
    # Number of steps on each side
    nx = int(math.ceil(halfRangeX / gx))
    ny = int(math.ceil(halfRangeY / gy))
    
    # Build grid using integer indexing → no accumulated floating-point errors
    xs = [round(i * gx, 10) for i in range(-nx, nx + 1)]
    ys = [round(i * gy, 10) for i in range(-ny, ny + 1)]
    



    z_high, z_low = maxZ+abs(zBuffer), minZ-abs(zBuffer)

    # Build grid nodes 
    pts_grid = [[None for j in range(len(ys))] for i in range(len(xs))]

    # polygon sampling for inside test
    sample_pts = []
    for c in flat_curves:
        try:
            n = 200
            for t in [float(i)/(n-1) for i in range(n)]:
                p = c.PointAtParameter(t)
                sample_pts.append((p.X, p.Y))
        except:
            pass

    for i, x in enumerate(xs):
        for j, y in enumerate(ys):
            if not point_in_poly(x, y, sample_pts):
                continue
            p_up = Point.ByCoordinates(x, y, z_high)
            p_down = Point.ByCoordinates(x, y, z_low)
            vl = Line.ByStartPointEndPoint(p_up, p_down)
            try:
                inter = srf.Intersect(vl)
                if inter:
                    pts_grid[i][j] = max(inter, key=lambda pt: pt.Z)
            except:
                pass

    # Find boundary intersections per grid line 
    boundary_nodes = []   # list of tuples: (point_on_surface, 'vert' or 'horiz', index)
    # vertical gridlines intersections
    for xi, x in enumerate(xs):
        testLine = Line.ByStartPointEndPoint(Point.ByCoordinates(x, minY, 0), Point.ByCoordinates(x, maxY, 0))
        for c in flat_curves:
            try:
                ints = testLine.Intersect(c)
                if ints:
                    for p in ints:
                        p_up = Point.ByCoordinates(p.X, p.Y, z_high)
                        p_down = Point.ByCoordinates(p.X, p.Y, z_low)
                        vl = Line.ByStartPointEndPoint(p_up, p_down)
                        inter_srf = srf.Intersect(vl)
                        if inter_srf:
                            best = max(inter_srf, key=lambda pt: pt.Z)
                            boundary_nodes.append((best, 'vert', xi))
            except:
                pass

    # horizontal gridlines intersections
    for yj, y in enumerate(ys):
        testLine = Line.ByStartPointEndPoint(Point.ByCoordinates(minX, y, 0), Point.ByCoordinates(maxX, y, 0))
        for c in flat_curves:
            try:
                ints = testLine.Intersect(c)
                if ints:
                    for p in ints:
                        p_up = Point.ByCoordinates(p.X, p.Y, z_high)
                        p_down = Point.ByCoordinates(p.X, p.Y, z_low)
                        vl = Line.ByStartPointEndPoint(p_up, p_down)
                        inter_srf = srf.Intersect(vl)
                        if inter_srf:
                            best = max(inter_srf, key=lambda pt: pt.Z)
                            boundary_nodes.append((best, 'horiz', yj))
            except:
                pass

    # Lines inside grid (connect consecutive interior nodes per row/column)
    horiz_lines = []
    for j in range(len(ys)):
        # collect (x,point) pairs for this row, sorted by X
        pts = [(xs[i], pts_grid[i][j]) for i in range(len(xs)) if pts_grid[i][j] is not None]
        pts.sort(key=lambda a: a[0])
        for k in range(len(pts)-1):
            a = pts[k][1]; b = pts[k+1][1]
            try:
                horiz_lines.append(Line.ByStartPointEndPoint(a, b))
            except:
                pass

    vert_lines = []
    for i in range(len(xs)):
        pts = [(ys[j], pts_grid[i][j]) for j in range(len(ys)) if pts_grid[i][j] is not None]
        pts.sort(key=lambda a: a[0])
        for k in range(len(pts)-1):
            a = pts[k][1]; b = pts[k+1][1]
            try:
                vert_lines.append(Line.ByStartPointEndPoint(a, b))
            except:
                pass

    # Connect boundary nodes back to correct grid line (robust snapping)
    connector_lines = []
    # filter out any None entries for safety
    boundary_nodes = [(p,typ,idx) for (p,typ,idx) in boundary_nodes if p is not None]

    for bpt, typ, idx in boundary_nodes:
        try:
            if typ == 'vert':
                # find nearest column index to the boundary point's X (safer than trusting idx)
                col_idx = nearest_index(bpt.X, xs)
                if col_idx is None: 
                    continue
                # collect column points (sorted by Y)
                col_pts = [(ys[j], pts_grid[col_idx][j]) for j in range(len(ys)) if pts_grid[col_idx][j] is not None]
                if not col_pts:
                    continue
                col_pts.sort(key=lambda a: a[0])
                # choose end (closest Y) to connect to
                if bpt.Y < col_pts[0][0]:
                    end_pt = col_pts[0][1]
                elif bpt.Y > col_pts[-1][0]:
                    end_pt = col_pts[-1][1]
                else:
                    # find nearest by Y
                    nearest_j = min(range(len(col_pts)), key=lambda ii: abs(col_pts[ii][0] - bpt.Y))
                    end_pt = col_pts[nearest_j][1]
                try:
                    connector_lines.append(Line.ByStartPointEndPoint(end_pt, bpt))
                except:
                    pass

            else:  # 'horiz'
                row_idx = nearest_index(bpt.Y, ys)
                if row_idx is None:
                    continue
                row_pts = [(xs[i], pts_grid[i][row_idx]) for i in range(len(xs)) if pts_grid[i][row_idx] is not None]
                if not row_pts:
                    continue
                row_pts.sort(key=lambda a: a[0])
                if bpt.X < row_pts[0][0]:
                    end_pt = row_pts[0][1]
                elif bpt.X > row_pts[-1][0]:
                    end_pt = row_pts[-1][1]
                else:
                    nearest_i = min(range(len(row_pts)), key=lambda ii: abs(row_pts[ii][0] - bpt.X))
                    end_pt = row_pts[nearest_i][1]
                try:
                    connector_lines.append(Line.ByStartPointEndPoint(end_pt, bpt))
                except:
                    pass
        except:
            pass

    # Combine outputs 
    # Correct iteration order: i over xs, j over ys
    all_nodes = [pts_grid[i][j] for i in range(len(xs)) for j in range(len(ys)) if pts_grid[i][j] is not None]
    all_nodes += [bpt for bpt, _, _ in boundary_nodes]

    # Build perimeter connections (safely)
    perimeter_nodes = [bpt for bpt, _, _ in boundary_nodes]
    perimeter_nodes = [p for p in perimeter_nodes if p is not None]
    if len(perimeter_nodes) > 2:
        cx = sum(p.X for p in perimeter_nodes) / len(perimeter_nodes)
        cy = sum(p.Y for p in perimeter_nodes) / len(perimeter_nodes)
        perimeter_nodes = sorted(perimeter_nodes, key=lambda p: math.atan2(p.Y - cy, p.X - cx))

        perimeter_lines = []
        for i in range(len(perimeter_nodes)):
            a = perimeter_nodes[i]
            b = perimeter_nodes[(i+1) % len(perimeter_nodes)]
            try:
                perimeter_lines.append(Line.ByStartPointEndPoint(a, b))
            except:
                pass
    else:
        perimeter_lines = []

    # NEW: collect nodes with Z ≈ 0 within tolerance 
    z_tol = 1e-2
    nodes_at_z0 = [p for p in all_nodes if p is not None and abs(p.Z) <= z_tol]

    # FINAL OUTPUTS 
    OUT = (
        all_nodes,                                 # all surface-projected nodes (grid + boundary)
        horiz_lines + vert_lines + connector_lines + perimeter_lines,  # all lines including perimeter
        perimeter_nodes,                           # perimeter (boundary) nodes on the surface
        nodes_at_z0                                # nodes whose Z is within tolerance of 0
    )
# ----------------------------------------

code_block_5 = CodeBlock { 0; 1; 2; 3; }

# group: Importing Members into Robot
getItemAtIndex = List.GetItemAtIndex(list=creating_hypar_grid, index=code_block_5.out1)
flatten_3 = List.Flatten(list=getItemAtIndex)
gate = Gate(false, flatten_3)
byLine = DynamoSimulation.RSA.AnalyticalModel.AnalyticalMember.ByLine(line=gate)

# group: Material
materials = Material("Bamboo")
setMaterialByName = DynamoSimulation.RSA.AnalyticalModel.AnalyticalMember.SetMaterialByName(analyticalMembers=byLine, name=materials)

# group: Section
sections = SectionMember("GUADUA 103x13")
setSectionByName = DynamoSimulation.RSA.AnalyticalModel.AnalyticalMember.SetSectionByName(analyticalMembers=setMaterialByName, name=sections)

# group: Finding Supports
getItemAtIndex_2 = List.GetItemAtIndex(list=creating_hypar_grid, index=code_block_5.out3)
flatten_4 = List.Flatten(list=getItemAtIndex_2)
gate_2 = Gate(false, flatten_4)
byPoint = DynamoSimulation.RSA.AnalyticalModel.AnalyticalNode.ByPoint(point=gate_2)

# group: Importing Supports into Robot
supports = Support("Pinned")
setSupportByName = DynamoSimulation.RSA.AnalyticalModel.AnalyticalNode.SetSupportByName(nodes=byPoint, name=supports)

# group: Self Weight
case_nature = CaseNature("Dead")
string = StringInput("Self Weight")
byNature = DynamoSimulation.RSA.AnalyticalModel.Loads.LoadCase.ByNature(caseNature=case_nature, caseName=string)
createSelfWeightLoad = DynamoSimulation.RSA.AnalyticalModel.Loads.SelfWeightLoad.CreateSelfWeightLoad(loadCase=byNature)
loadCase = DynamoSimulation.RSA.AnalyticalModel.Loads.SelfWeightLoad.LoadCase(selfWeightLoad=createSelfWeightLoad)

# group: Importing Planes into Robot
getItemAtIndex_3 = List.GetItemAtIndex(list=creating_hypar_grid, index=code_block_5.out0)
python_script = Python(IN[0]=getItemAtIndex_3, IN[1]=flatten_3)  # CPython3
# ---------- python_script.python (206 lines) ----------
import sys
import clr
clr.AddReference('ProtoGeometry')
from Autodesk.DesignScript.Geometry import *


dataEnteringNode = IN


nodes_in = IN[0]
members = IN[1]

# flatten nested node lists 
def flatten(lst):
    out = []
    for item in lst:
        if isinstance(item, (list, tuple)):
            out.extend(flatten(item))
        else:
            out.append(item)
    return out

nodes = flatten(nodes_in)

def ensure_point(p):
    if hasattr(p, "X"):
        return p
    elif isinstance(p, (list, tuple)) and len(p) == 3:
        return Point.ByCoordinates(p[0], p[1], p[2])
    else:
        raise TypeError("Unsupported node type: {}".format(p))

nodes = [ensure_point(p) for p in nodes]

#  adjacency map 
adj = {i: set() for i in range(len(nodes))}

def key(pt):
    return (round(pt.X, 5), round(pt.Y, 5), round(pt.Z, 5))

node_lookup = {key(n): i for i, n in enumerate(nodes)}

if hasattr(members[0], "StartPoint"):
    for m in members:
        k1, k2 = key(m.StartPoint), key(m.EndPoint)
        if k1 in node_lookup and k2 in node_lookup:
            i1, i2 = node_lookup[k1], node_lookup[k2]
            adj[i1].add(i2)
            adj[i2].add(i1)
else:
    for pair in members:
        if len(pair) == 2:
            i1, i2 = pair
            if 0 <= i1 < len(nodes) and 0 <= i2 < len(nodes):
                adj[i1].add(i2)
                adj[i2].add(i1)

# distance function 
def dist(i, j):
    p1, p2 = nodes[i], nodes[j]
    return ((p1.X - p2.X)**2 + (p1.Y - p2.Y)**2 + (p1.Z - p2.Z)**2)**0.5

# detect triangles directly
triangles = set()
for a in adj:
    for b in adj[a]:
        if b <= a:
            continue
        for c in adj[a]:
            if c <= b:
                continue
            if c in adj[b]:
                triangles.add(tuple(sorted([a, b, c])))

# detect quads 
quads = set()
for a in adj:
    for b in adj[a]:
        for c in adj[b]:
            if c in [a, b]:
                continue
            for d in adj[c]:
                if d in [a, b, c]:
                    continue
                if (a in adj[d]) and (b in adj[c]) and not ((a in adj[c]) or (b in adj[d])):
                    quads.add(tuple(sorted([a, b, c, d])))

#  triangulate quads 
quad_tris = set()
for q in quads:
    a = list(q)[0]
    neighbors_a = [n for n in adj[a] if n in q]
    if len(neighbors_a) != 2:
        continue
    b, d = neighbors_a
    c_candidates = [n for n in adj[b] if n in q and n not in [a, d]]
    if not c_candidates:
        c_candidates = [n for n in adj[d] if n in q and n not in [a, b]]
    if not c_candidates:
        continue
    c = c_candidates[0]
    d1 = dist(a, c)
    d2 = dist(b, d)
    if d1 <= d2:
        quad_tris.add(tuple(sorted([a, b, c])))
        quad_tris.add(tuple(sorted([a, c, d])))
    else:
        quad_tris.add(tuple(sorted([a, b, d])))
        quad_tris.add(tuple(sorted([b, c, d])))

# pentagon detection
# Ensure that only clean 5-node cycles with no internal diagonals are counted.
pentagons = set()

for a in range(len(nodes)):
    for b in adj[a]:
        if b <= a:  # avoid duplicates
            continue
        for c in adj[b]:
            if c in [a, b]:
                continue
            for d in adj[c]:
                if d in [a, b, c]:
                    continue
                for e in adj[d]:
                    if e in [a, b, c, d]:
                        continue
                    if a in adj[e]:
                        cycle = [a, b, c, d, e]
                        # check for diagonals
                        has_diagonal = False
                        for i in range(5):
                            ni = cycle[i]
                            for j in range(i + 2, i + 4):  # skip adjacent + self
                                nj = cycle[j % 5]
                                if nj in adj[ni]:
                                    has_diagonal = True
                                    break
                            if has_diagonal:
                                break
                        if not has_diagonal:
                            pentagons.add(tuple(sorted(cycle)))

# triangulate pentagons using centroid 
pent_tris = []

for p in pentagons:
    # order the perimeter using adjacency
    a = list(p)[0]
    neighbors_a = [n for n in adj[a] if n in p]
    if len(neighbors_a) != 2:
        continue
    b, e = neighbors_a
    ordered = [a, b]
    current = b
    prev = a
    while len(ordered) < 5:
        next_nodes = [n for n in adj[current] if n in p and n != prev]
        if not next_nodes:
            break
        next_node = next_nodes[0]
        ordered.append(next_node)
        prev = current
        current = next_node
    if len(ordered) != 5:
        continue

    # Compute centroid
    pts = [nodes[i] for i in ordered]
    cx = sum(pt.X for pt in pts) / 5.0
    cy = sum(pt.Y for pt in pts) / 5.0
    cz = sum(pt.Z for pt in pts) / 5.0
    centroid = Point.ByCoordinates(cx, cy, cz)

    # Create fan of triangles (edge + centroid)
    for i in range(5):
        a_idx = ordered[i]
        b_idx = ordered[(i + 1) % 5]
        pent_tris.append([nodes[a_idx], nodes[b_idx], centroid])

# combine all triangles 
all_tris = triangles.union(quad_tris)

# create surfaces 
surfaces = []

# triangles + quads
for tri in all_tris:
    pts = [nodes[i] for i in tri]
    try:
        srf = Surface.ByPerimeterPoints(pts)
        if srf:
            surfaces.append(srf)
    except:
        pass

# pentagons
for tri_pts in pent_tris:
    try:
        srf = Surface.ByPerimeterPoints(tri_pts)
        if srf:
            surfaces.append(srf)
    except:
        pass

OUT = surfaces
# ----------------------------------------
gate_3 = Gate(false, python_script)
bySurface = DynamoSimulation.RSA.AnalyticalModel.AnalyticalPanel.BySurface(surface=gate_3)

# group: Dead Load
case_nature_2 = CaseNature("Dead")
string_2 = StringInput("Dead")
byNature_2 = DynamoSimulation.RSA.AnalyticalModel.Loads.LoadCase.ByNature(caseNature=case_nature_2, caseName=string_2)
code_block_6 = CodeBlock { -50; }
byPanels = DynamoSimulation.RSA.AnalyticalModel.Loads.UniformSurfaceLoad.ByPanels(analyticalPanels=bySurface, loadCase=byNature_2, fz=code_block_6)

# group: Live Load
case_nature_3 = CaseNature("Snow")
string_3 = StringInput("Snow")
byNature_3 = DynamoSimulation.RSA.AnalyticalModel.Loads.LoadCase.ByNature(caseNature=case_nature_3, caseName=string_3)
code_block_7 = CodeBlock { -600; }
byPanels_2 = DynamoSimulation.RSA.AnalyticalModel.Loads.UniformSurfaceLoad.ByPanels(analyticalPanels=bySurface, loadCase=byNature_3, fz=code_block_7)

code_block_8 = CodeBlock {  }
